# Dynamo graph Flat Pack House - amended.dyn (Dynamo 2.5.0.7460)

categories = Categories("OST_StructuralFraming")
all_elements_of_category = ElementsOfCategory(Category=categories)
categories_2 = Categories("OST_StructuralColumns")
all_elements_of_category_2 = ElementsOfCategory(Category=categories_2)
categories_3 = Categories("OST_Floors")
all_elements_of_category_3 = ElementsOfCategory(Category=categories_3)
categories_4 = Categories("OST_Walls")
all_elements_of_category_4 = ElementsOfCategory(Category=categories_4)
list_create = List.Create(item0=all_elements_of_category, item1=all_elements_of_category_2, item2=all_elements_of_category_3, item3=all_elements_of_category_4)
geometry = Element.Geometry(element=list_create)
centroid = Solid.Centroid(solid=geometry)
assembly_sequence = Python(IN[0]=centroid)
# ---------- assembly_sequence.python (4 lines) ----------
import clr
from operator import itemgetter
orglst = IN[0]
OUT = sorted(orglst, key=itemgetter(1,2,3))
# ----------------------------------------
