# Dynamo graph Flat Pack House.dyn (Dynamo 2.5.0.7460)

file_path = Filename("C:\Users\admin\Desktop\Flat Pack House.xlsx")
string = StringInput("Sheet1")
code_block = CodeBlock { 0; }
code_block_2 = CodeBlock { ["Assembly Sequential Numbering","Element","Level","Section Shape","Length","Width","Height","Lip Length","Thickness","Top Bend Length","Bottom Bend Length","Bottom Bend Width","Material","Centroid"]; }
join = List.Join()  # unwired: list0, list1, list2, list3, list4
code_block_3 = CodeBlock { 1; 73; 1; }
sequence = Sequence(start=code_block_3.out0, amount=code_block_3.out1, step=code_block_3.out2)
categories = Categories("OST_StructuralFraming")
all_elements_of_category = ElementsOfCategory(Category=categories)
categories_2 = Categories("OST_StructuralColumns")
all_elements_of_category_2 = ElementsOfCategory(Category=categories_2)
categories_3 = Categories("OST_Floors")
all_elements_of_category_3 = ElementsOfCategory(Category=categories_3)
list_create = List.Create(item0=all_elements_of_category, item1=all_elements_of_category_2, item2=all_elements_of_category_3)
flatten = List.Flatten(list=list_create)
geometry = Element.Geometry(element=flatten)
centroid = Solid.Centroid(solid=geometry)
code_block_4 = CodeBlock { 0; }
getItemAtIndex = List.GetItemAtIndex(list=centroid, index=code_block_4, lacing=CrossProduct)
flatten_2 = List.Flatten(list=getItemAtIndex)
code_block_5 = CodeBlock(elem=flatten, pt=flatten_2) { Transpose([elem,Math.Round(pt.Z,2),Math.Round(pt.Y,2),Math.Round(pt.X,2)]); }
python_script = Python(IN[0]=code_block_5)
# ---------- python_script.python (4 lines) ----------
import clr
from operator import itemgetter
orglst = IN[0]
OUT = sorted(orglst, key=itemgetter(1,2,3))
# ----------------------------------------
code_block_6 = CodeBlock { 0; }
getItemAtIndex_2 = List.GetItemAtIndex(list=python_script, index=code_block_6, lacing=CrossProduct)
categories_4 = Categories("OST_Walls")
all_elements_of_category_4 = ElementsOfCategory(Category=categories_4)
code_block_7 = CodeBlock { [0,1]; }
removeItemAtIndex = List.RemoveItemAtIndex(list=all_elements_of_category_4, indices=code_block_7)
categories_5 = Categories("OST_Doors")
all_elements_of_category_5 = ElementsOfCategory(Category=categories_5)
categories_6 = Categories("OST_Windows")
all_elements_of_category_6 = ElementsOfCategory(Category=categories_6)
list_create_2 = List.Create(item0=removeItemAtIndex, item1=all_elements_of_category_5, item2=all_elements_of_category_6)
flatten_3 = List.Flatten(list=list_create_2)
geometry_2 = Element.Geometry(element=flatten_3)
centroid_2 = Solid.Centroid(solid=geometry_2)
code_block_8 = CodeBlock { 0; }
getItemAtIndex_3 = List.GetItemAtIndex(list=centroid_2, index=code_block_8, lacing=CrossProduct)
flatten_4 = List.Flatten(list=getItemAtIndex_3)
code_block_9 = CodeBlock(elem=flatten_3, pt=flatten_4) { Transpose([elem,Math.Round(pt.Z,2),Math.Round(pt.Y,2),Math.Round(pt.X,2)]); }
python_script_2 = Python(IN[0]=code_block_9)  # same code as python_script
code_block_10 = CodeBlock { 0; }
getItemAtIndex_4 = List.GetItemAtIndex(list=python_script_2, index=code_block_10, lacing=CrossProduct)
list_create_3 = List.Create(item0=getItemAtIndex_2, item1=getItemAtIndex_4)
flatten_5 = List.Flatten(list=list_create_3)
name = Element.Name(element=flatten_5)
code_block_11 = CodeBlock { ["Level","Section Shape","Length","Width","Height","Lip Length","Thickness","Top Bend Length","Bottom Bend Length","Bottom Bend Width"]; }
getParameterValueByName = Element.GetParameterValueByName(element=flatten_5, parameterName=code_block_11, lacing=CrossProduct)
code_block_12 = CodeBlock { ["Structural Material"]; }
getParameterValueByName_2 = Element.GetParameterValueByName(element=flatten_5, parameterName=code_block_12, lacing=CrossProduct)
name_2 = Material.Name(material=getParameterValueByName_2)
code_block_13 = CodeBlock { 3; }
getItemAtIndex_5 = List.GetItemAtIndex(list=python_script, index=code_block_13, lacing=CrossProduct)
code_block_14 = CodeBlock { 2; }
getItemAtIndex_6 = List.GetItemAtIndex(list=python_script, index=code_block_14, lacing=CrossProduct)
code_block_15 = CodeBlock { 1; }
getItemAtIndex_7 = List.GetItemAtIndex(list=python_script, index=code_block_15, lacing=CrossProduct)
byCoordinates = Point.ByCoordinates(x=getItemAtIndex_5, y=getItemAtIndex_6, z=getItemAtIndex_7)
code_block_16 = CodeBlock { 3; }
getItemAtIndex_8 = List.GetItemAtIndex(list=python_script_2, index=code_block_16, lacing=CrossProduct)
code_block_17 = CodeBlock { 2; }
getItemAtIndex_9 = List.GetItemAtIndex(list=python_script_2, index=code_block_17, lacing=CrossProduct)
code_block_18 = CodeBlock { 1; }
getItemAtIndex_10 = List.GetItemAtIndex(list=python_script_2, index=code_block_18, lacing=CrossProduct)
byCoordinates_2 = Point.ByCoordinates(x=getItemAtIndex_8, y=getItemAtIndex_9, z=getItemAtIndex_10)
list_create_4 = List.Create(item0=byCoordinates, item1=byCoordinates_2)
flatten_6 = List.Flatten(list=list_create_4)
combine = List.Combine(comb=join, list1=sequence, list2=name, list3=getParameterValueByName, list4=name_2, list5=flatten_6)
addItemToFront = List.AddItemToFront(item=code_block_2, list=combine)
boolean = BoolSelector(true)
exportExcel = Data.ExportExcel(filePath=file_path, sheetName=string, startRow=code_block, startCol=code_block, data=addItemToFront, overWrite=boolean)
